# Grasshopper definition Pull user text from GIS import.gh (Grasshopper 1.0.7)
# plug-ins: ItemSelector, Human, EleFront, MetaHopper

# ----
# SELECT LAYER
button = Button()
layer_table = LayerTable(Update=button, AutoUpdate=False)  # -> Layers, FullLayerPaths, LayerColors, Linetypes, MaterialNames, Visible, PrintWidth, PrintColor
item_selector = ItemSelector(layer_table.Layers, {"Default", "BFN_Contours"}, selected="BFN_Contours")

document_info = DocumentInfo(AutoUpdate=False, Recursive=False)  # -> DocumentName, DocumentFilePath, Components, Params, _3rdPartyAssemblies
panel = Panel(document_info._3rdPartyAssemblies)

# ----
# GET FEATURES AND ATTRIBUTES
dynamic_geometry_pipeline = DynamicGeometryPipeline(
    LayerFilter=item_selector,
    TypeFilter="All",
    NameFilter="*",
    GroupByLayer=False,
    GroupByType=False,
    IncludeHidden=True,
    IncludeLocked=True,
    enableFullPath=True,
    listenToAttributes=True)
get_user_text = GetUserText(Geometry=dynamic_geometry_pipeline)  # -> simplify(Keys), simplify(Values)
tree_branch = TreeBranch(Tree=get_user_text.Keys, Path="{0}", MaintainPaths=True)
geometry = Geometry(dynamic_geometry_pipeline)
attributes = Text(tree_branch)
values = Text(get_user_text.Values)

# ----
# QUERY FIELD
item_selector_2 = ItemSelector(attributes, {"OBJECTID_1", "Shape", "OBJECTID", "FEATURECOD", "UPDATE_YEA", "ELEVATION"}, selected="ELEVATION")
indexof = CSharpScript(x=item_selector_2, y=attributes)  # -> out, A; inputs x: String, y: list of String
# ---------- indexof: C# ----------
    int index = -1;
    for (int i = 0; i < y.Count; i++){
      if (x.Equals(y[i])) index = i;
    }
    A = index;
# ---------- end indexof ----------
list_item = ListItem(List=values, Index=indexof.A, Wrap=True)  # -> flatten(Item)
panel_2 = Panel(list_item)
panel_3 = Panel(item_selector_2)
